# Grasshopper definition NamedViews_2_C4Dcameras.gh (Grasshopper 1.0.7)
# Copyright: Co-de-iT

# open a Rhino file containing Named Views and click the update button.
# 
# Click update every time a new named view is saved.
update = Button()
# Rhino Named Views to Cinema4D Cameras
# 
# © a3 2019 _ Creative Commons Attribution-NonCommercial-ShareAlike3.0 UnportedLicense.
data_order = Panel("""name: 
lens: 
 P.X: 
 P.Y: 
 P.Z: 
 R.H: 
 R.P: 
 R.B: """)
c_script = CSharpScript(update=update)  # -> data; inputs update: Boolean
# ---------- c_script: C# usings ----------
using System.IO;
using System.Linq;
using System.Data;
using System.Drawing;
using System.Reflection;
using System.Windows.Forms;
using System.Xml;
using System.Xml.Linq;
using System.Runtime.InteropServices;

using Rhino.DocObjects;
using Rhino.Collections;
using GH_IO;
using GH_IO.Serialization;
# ---------- c_script: C# ----------
    //Extract Named viewports list
    Rhino.DocObjects.Tables.NamedViewTable nV = doc.NamedViews;

    // return if list is empty
    if (nV.Count == 0) return;

    DataTree<String> camData = new DataTree<String>();
    //camData.AddRange( new string[]{"name", "lens", "P.X", "P.Y", "P.Z", "H", "P", "B"}, new GH_Path(0));

    ViewportInfo vp;
    List<String> nVData;
    Vector3d dir, up;
    double H, P, B;

    for(int i = 0; i < nV.Count; i++)
    {
      nVData = new List<String>();

      // name
      nVData.Add(nV[i].Name);

      vp = nV[i].Viewport;

      // lens
      nVData.Add(Math.Round(vp.Camera35mmLensLength, 1).ToString());

      // P.X, P.Y, P.Z (in Cinema 4D Y is the up-axis, so X and Y coordinates are swapped)
      nVData.Add(Math.Round(vp.CameraLocation.X, 3).ToString());
      nVData.Add(Math.Round(vp.CameraLocation.Z, 3).ToString());
      nVData.Add(Math.Round(vp.CameraLocation.Y, 3).ToString());

      dir = vp.CameraDirection;
      up = vp.CameraUp;

      // H (Heading)
      Vector3d flatDir = new Vector3d(dir.X, dir.Y, 0);
      H = Vector3d.VectorAngle(Vector3d.XAxis, flatDir, Plane.WorldXY);
      H = Math.Round((180 / Math.PI) * H - 90, 3);
      nVData.Add(Convert.ToString(H));

      // P (Pitch)
      Vector3d invDir = new Vector3d(-dir.X, -dir.Y, -dir.Z);
      P = Vector3d.VectorAngle(invDir, Vector3d.ZAxis);
      P = Math.Round((180 / Math.PI) * P - 90, 3);
      nVData.Add(Convert.ToString(P));

      // B (Bank)
      Vector3d flatRot = Vector3d.CrossProduct(Vector3d.ZAxis, dir);
      B = Vector3d.VectorAngle(up, flatRot);
      B = Math.Round((180 / Math.PI) * B - 90, 3);
      nVData.Add(Convert.ToString(B));

      camData.AddRange(nVData, new GH_Path(i));

    }

    // update if you add new named views to Rhino
    if (update) Component.ExpireSolution(true);


    data = camData;
# ---------- end c_script ----------
concat = Concatenate(FragmentA=data_order, FragmentB=c_script)
# Cinema 4D is an animation-oriented software. For this reason:
# 
# . cameras use HPB (Heading, Pitch, Bank) orientation system
# 
# . the up-axis is the Y axis
# 
# This component generates the data you need to input in the Cinema camera object and coordinates in order to rebuild the exact named views generated and stored in Rhino. Coordinates P.X, P.Y, P.Z are already in the correct order for Cinema.
panel = Panel(concat)
