# Grasshopper definition a3_c00_geometry data 01 - points-curves.gh (Grasshopper 1.0.7)
# Copyright: © 2018

# ---- group: referenced point from Rhino
pt = Point(<point referenced from the Rhino model>)

# ---- group: point tagging
tag = TextTag3D(Location=pt, Text="P", Size=1, Justification=7)

# ---- group: activate/deactivate reparametrize
# curves
crv = Curve(reparameterize(<curve referenced from the Rhino model>))

# ----
number_slider = Slider(0.466, range=0..1)
amplifier = Slider(5.365, range=1..10)
n_points = Slider(47, range=10..100)
# Geometry data 01
# 
# © a3 2018 _ Creative Commons Attribution-NonCommercial-ShareAlike3.0 UnportedLicense.
# points & vectors
what_it_is = Panel(pt)
# curves - connections
# before trying this, check the data tree 01 definition
crv_2 = Curve(reparameterize([<curve referenced from the Rhino model> x2]))
number_slider_2 = Slider(100, range=10..100)
number_slider_3 = Slider(4, range=1..10)
crv_3 = Curve(reparameterize(<curve referenced from the Rhino model>))
# shift lists
crv_4 = Curve(reparameterize(<curve referenced from the Rhino model>))

# ---- group: 0,0,0
pt_2 = Point(Point(0, 0, 0))

# ----
curvature = Curvature(Curve=crv, Parameter=number_slider)  # -> P, K, C
domain = Domain(crv)

# ---- group: every point can be used as a vector....
vec = Vector(pt)

# ----
vdisex = VectorDisplayEx(Point=pt_2, Vector=vec, Colour=RGB(0, 0, 0), Width=2)
unit = UnitVector(Vector=curvature.K)
divide = DivideCurve(Curve=crv_2, Count=n_points, Kinks=False)  # -> Points, Tangents, Parameters
# when reparametrize is active, the curve domain is normalized between 0 and 1, making all curve operations much more comfortable
curve_domain = Panel(domain)

# ---- group: deconstruct point
pdecon = Deconstruct(Point=pt)  # -> XComponent, YComponent, ZComponent

# ---- group: evaluate curve
eval = EvaluateCurve(Curve=crv, Parameter=number_slider)  # -> Point, Tangent, Angle

# ---- group: deconstruct vector
devec = DeconstructVector(Vector=vec)  # -> XComponent, YComponent, ZComponent

# ----
series = Series(Start=0, Step=1, Count=number_slider_3)
charseq = CharSequence(Count=number_slider_3, CharPool="ABCDEFGHIJKLMNOPQRSTUVWXYZ", Format="{0}")
divide_2 = DivideCurve(Curve=crv_3, Count=number_slider_2, Kinks=False)  # -> Points, Tangents, Parameters
divide_3 = DivideCurve(Curve=crv_4, Count=number_slider_2, Kinks=False)  # -> Points, Tangents, Parameters

# ---- group: visualize tangent
multiplication = Multiplication(A=eval.Tangent, B=amplifier)
vdisex_2 = VectorDisplayEx(Point=eval.Point, Vector=multiplication, Colour=ColourSwatch(SwatchColor=RGB(247, 255, 0)), Width=2)

# ---- group: ....and vice-versa / unit vector Y
Y = UnitY(Factor=1)

# ----
multiplication_2 = Multiplication(A=unit, B=Slider(5.413, range=0..30))

# ----
# quiz: activate the preview on this "Average" component. What will you see?
# 
# 1. one average point in each curve
# 
# 2. one average point for each corsponding couple of points in each curve, forming the trace for an intermediate curve
# 
# 3. one single point averaging all of the points in every curve
avr = Average(Input=divide.Points)

# ----
# solution: move this panel away to uncover the solution
panel = Panel("1")
panel_2 = Panel(divide.Points)
viewer = ParamViewer(divide.Points)

# ---- group: perp frame
pframe = PerpFrame(Curve=crv, Parameter=number_slider)
rectangle = Rectangle(Plane=pframe, XSize="-2 to 2", YSize="-2 to 2", Radius=0)  # -> Rectangle, Length

# ----
entwine = Entwine(Branch00=series, Branch01=charseq, FlattenInputs=True)

# ---- group: point data
# quiz
# play with me!
panel_3 = Panel(pdecon.XComponent)
panel_4 = Panel(pdecon.YComponent)
panel_5 = Panel(pdecon.ZComponent)

# ---- group: vector components
panel_6 = Panel(devec.XComponent)
panel_7 = Panel(devec.ZComponent)
panel_8 = Panel(devec.YComponent)

# ----
# curvature
vdisex_3 = VectorDisplayEx(Point=eval.Point, Vector=multiplication_2, Colour=ColourSwatch(SwatchColor=RGB(0, 255, 47)), Width=2)
dots = DotDisplay(Point=eval.Point, Colour=RGB(0, 0, 0), Size="0.3")

# ---- group: ....and vice-versa
pt_3 = Point(Y)

# ----
vdisex_4 = VectorDisplayEx(Point=pt_2, Vector=Y, Colour=ColourSwatch(SwatchColor=RGB(255, 255, 255)), Width=2)
panel_9 = Panel("M 2xN")
pt_4 = Point(eval.Point)
panel_10 = Panel(entwine)
shift = ShiftList(List=divide_2.Points, Shift=Slider(30, range=0..100), Wrap="true")

# ---- group: 0,0,0
pt_5 = Point(Point(0, 0, 0))

# ---- group: multiplication vs magnitude
number_slider_4 = Slider(0.661, range=0..5)
multiplication_3 = Multiplication(A=vec, B=number_slider_4)
amp = Amplitude(Vector=vec, Amplitude=number_slider_4)
vdisex_5 = VectorDisplayEx(Point=pt_5, Vector=multiplication_3, Colour=ColourSwatch(SwatchColor=RGB(255, 242, 0)), Width=2)
vdisex_6 = VectorDisplayEx(Point=pt_5, Vector=amp, Colour=ColourSwatch(SwatchColor=RGB(255, 106, 0)), Width=2)

# ----
pdecon_2 = Deconstruct(Point=pt_4)  # -> XComponent, YComponent, ZComponent
entwine_2 = Entwine(Branch00=divide_3.Points, Branch01=shift, FlattenInputs=True)
flip = FlipMatrix(Data=divide.Points)
ln = Line(StartPoint=divide_3.Points, EndPoint=shift)
item = ListItem(List=ln, Index=0, Wrap=True)
item_2 = ListItem(List=entwine_2, Index=0, Wrap=True)
viewer_2 = ParamViewer(flip)
panel_11 = Panel(flip)
panel_12 = Panel("Mt Nx2")

# ---- group: visualize xyz lines
pt_6 = ConstructPoint(XCoordinate=0, YCoordinate=pdecon_2.YComponent, ZCoordinate=0)
pt_7 = ConstructPoint(XCoordinate=pdecon_2.XComponent, YCoordinate=0, ZCoordinate=0)
pt_8 = ConstructPoint(XCoordinate=pdecon_2.XComponent, YCoordinate=pdecon_2.YComponent, ZCoordinate=0)
X = UnitX(Factor=1)
Y_2 = UnitY(Factor=1)
Z = UnitZ(Factor=1)
line = LineSDL(Start=pt_6, Direction=X, Length=pdecon_2.XComponent)
line_2 = LineSDL(Start=pt_7, Direction=Y_2, Length=pdecon_2.YComponent)
line_3 = LineSDL(Start=pt_8, Direction=Z, Length=pdecon_2.ZComponent)
crv_5 = Curve([line, line_2, line_3])
preview = CustomPreview(Geometry=crv_5, Material=ColourSwatch(SwatchColor=RGB(41, 41, 41)))

# ----
tag_2 = TextTag3D(
    Location=item_2,
    Text="0",
    Size=Slider(2.616, range=0..10),
    Colour=ColourSwatch(SwatchColor=RGB(255, 255, 255)),
    Justification=7)
preview_2 = CustomPreview(Geometry=item, Material="white")
dots_2 = DotDisplay(Point=item_2, Colour=RGB(0, 0, 0), Size="0.5")
avr_2 = Average(Input=flip)
Z_2 = UnitZ(Factor=Slider(4.623, range=0..10))
move = Move(Geometry=avr_2, Motion=Z_2)  # -> Geometry, Transform

# ---- group: visualize XYZ coordinates
merge = Merge(Data1=pt_7, Data2=pt_6, Data3=pt_4)
merge_2 = Merge(Data1=pdecon_2.XComponent, Data2=pdecon_2.YComponent, Data3=pdecon_2.ZComponent)
expression = Expression(x=merge_2, Expression="round(x,2) & \"   \"")
panel_13 = Panel("""2
6
6""")
tag_3 = TextTag3D(Location=merge, Text=expression, Size=1, Colour=ColourSwatch(SwatchColor=RGB(0, 0, 0)), Justification=panel_13)

# ----
pline = PolyLine(Vertices=flip, Closed=False)
merge_3 = Merge(Data1=flip, Data2=move.Geometry)
crv_6 = Curve(<curve referenced from the Rhino model>)
closed = BooleanToggle(True)

# ---- group: visualize parameter t
expression_2 = Expression(x=number_slider, Expression="\"  \" & round(x,2)")
tag_4 = TextTag3D(Location=pt_4, Text=expression_2, Size=1, Colour=ColourSwatch(SwatchColor=RGB(255, 255, 255)), Justification=4)

# ----
viewer_3 = ParamViewer(pline)
divide_4 = DivideCurve(Curve=crv_6, Count=Slider(14, range=10..100), Kinks=False)  # -> Points, Tangents, Parameters
panel_14 = Panel(pline)

# ---- group: C
pt_9 = Point(<point referenced from the Rhino model>)

# ---- group: A
# vector operations
pt_10 = Point(<point referenced from the Rhino model>)

# ---- group: B
pt_11 = Point(<point referenced from the Rhino model>)

# ----
pline_2 = PolyLine(Vertices=merge_3, Closed=closed)

# ---- group: point tagging
merge_4 = Merge(Data1=pt_10, Data2=pt_11, Data3=pt_9)
panel_15 = Panel("""A
B
C""")
tag_5 = TextTag3D(Location=merge_4, Text=panel_15, Size=1, Justification=7)

# ---- group: vector AB
vec2pt = Vector2Pt(PointA=pt_10, PointB=pt_11, Unitize=False)  # -> Vector, Length
vdisex_7 = VectorDisplayEx(Point=pt_10, Vector=vec2pt.Vector, Colour=RGB(0, 0, 0), Width=2)

# ---- group: vector AC
vec2pt_2 = Vector2Pt(PointA=pt_10, PointB=pt_9, Unitize=False)  # -> Vector, Length
# Relay: Relays can be inserted at any point on a cable by double clicking on it, I can then branch several cables from the relay itself. They are intended to tidy the GH code and keep things neat.
# 
# A double click on a relay will get you rid of it
vdisex_8 = VectorDisplayEx(Point=pt_10, Vector=vec2pt_2.Vector, Colour=RGB(0, 0, 0), Width=2)

# ----
shift_2 = ShiftList(List=divide_4.Points, Shift="-1", Wrap="false")
shift_3 = ShiftList(List=divide_4.Points, Shift="1", Wrap="false")
vec2pt_3 = Vector2Pt(PointA=shift_2, PointB=shift_3, Unitize=False)  # -> Vector, Length
# unless with curves of degree 1, the domain is not evenly distributed. The relative distance between control points regulates the local "density" of the domain.
# 
# In Rhino, play with the intermediate control points of the curves above, sliding them along the respective curve to see the connecting lines change according to local domain density
number_slider_5 = Slider(54, range=2..100)
vdisex_9 = VectorDisplayEx(Point=divide_4.Points, Vector=vec2pt_3.Vector, Colour=vec2pt_3.Vector, Width=2)

# ---- group: in Rhino, play with intermediate control points
# domain distribution
crv_7 = Curve(reparameterize(graft([<curve referenced from the Rhino model> x2])))

# ---- group: dot product AB . AC
unitize = BooleanToggle(True)
dprod = DotProduct(VectorA=vec2pt.Vector, VectorB=vec2pt_2.Vector, Unitize=unitize)

# ---- group: cross product AB x AC
unitize_2 = BooleanToggle(False)
xprod = CrossProduct(VectorA=vec2pt.Vector, VectorB=vec2pt_2.Vector, Unitize=unitize_2)  # -> Vector, Length

# ----
cp = ControlPoints(Curve=crv_7)  # -> Points, Weights, Knots
range = Range(Domain=Domain(0, 1), Steps=number_slider_5)

# ---- group: same as before
# Introducing variation by interpolation
crv_8 = Curve(reparameterize([<curve referenced from the Rhino model> x2]))
divide_5 = DivideCurve(Curve=crv_8, Count=Slider(47, range=10..100), Kinks=False)  # -> Points, Tangents, Parameters
flip_2 = FlipMatrix(Data=divide_5.Points)

# ---- group: vector subtraction / AC-AB
subtraction = Subtraction(A=vec2pt.Vector, B=vec2pt_2.Vector)

# ---- group: vector addition / AB+AC
addition = Addition(A=vec2pt.Vector, B=vec2pt_2.Vector)

# ---- group: vector addition
vdisex_10 = VectorDisplayEx(Point=pt_10, Vector=addition, Colour=ColourSwatch(SwatchColor=RGB(227, 14, 145)), Width=2)

# ---- group: vector subtraction
vdisex_11 = VectorDisplayEx(Point=pt_9, Vector=subtraction, Colour=ColourSwatch(SwatchColor=RGB(45, 143, 3)), Width=2)

# ----
eval_2 = EvaluateCurve(Curve=crv_7, Parameter=range)  # -> Point, Tangent, Angle
item_3 = ListItem(List=cp.Points, Index="1", Wrap=True)
bang = ExplodeTree(Data=eval_2.Point)  # -> Branch0, Branch1

# ---- group: vector angle
angle = Angle(VectorA=vec2pt.Vector, VectorB=vec2pt_2.Vector)  # -> Angle, Reflex
deg = Degrees(Radians=angle.Angle)
panel_16 = Panel(deg)

# ---- group: if vectors are unitized, the dot product is the cosine of the inner angle
acos = ArcCosine(Value=dprod)
deg_2 = Degrees(Radians=acos)
panel_17 = Panel(deg_2)

# ----
vdisex_12 = VectorDisplayEx(Point=pt_10, Vector=xprod.Vector, Colour=ColourSwatch(SwatchColor=RGB(0, 47, 255)), Width=2)

# ---- group: preview intermediate control points
dots_3 = DotDisplay(Point=item_3, Colour=RGB(0, 0, 0), Size="0.2")

# ----
ln_2 = Line(StartPoint=bang.Branch0, EndPoint=bang.Branch1)
avr_3 = Average(Input=flip_2)
lng = ListLength(List=flatten(avr_3))

# ---- group: interpolate - point sequence / base point sequence from Rhino
# play with the points position
pt_12 = Point([<point referenced from the Rhino model> x5])

# ---- group: interpolate - basics - points
pt_13 = Point(<point referenced from the Rhino model>)
swatch = ColourSwatch(SwatchColor=RGB(7, 149, 250))
pt_14 = Point(<point referenced from the Rhino model>)
swatch_2 = ColourSwatch(SwatchColor=RGB(250, 189, 7))
interpolate = Slider(0, range=0..1)
preview_3 = CustomPreview(Geometry=pt_13, Material=swatch)
preview_4 = CustomPreview(Geometry=pt_14, Material=swatch_2)
merge_5 = Merge(Data1=pt_13, Data2=pt_14)
merge_6 = Merge(Data1=swatch, Data2=swatch_2)
interp = InterpolateData(Data=merge_5, Parameter=interpolate, Interpolation=2)
interp_2 = InterpolateData(Data=merge_6, Parameter=interpolate, Interpolation=2)
preview_5 = CustomPreview(Geometry=interp, Material=interp_2)

# ---- group: interpolate - basics - data
number_slider_6 = Slider(0.891, range=0..10)
number_slider_7 = Slider(2.555, range=0..10)
number_slider_8 = Slider(3.8, range=0..10)
number_slider_9 = Slider(123, range=10..200)

# ----
# exercise: 1. use a new graph mapper to control Z height
# 
# 2. make it a negative Z or cross between + and - values
# 
# 3. experiment with more graphs (Sine, etc.)
range_2 = Range(Domain=Domain(0, 1), Steps=expr("x-1", lng))  # -> simplify(graft(Range))
graph = GraphMapper(range_2, x0=0, x1=1, y0=0, y1=1, container_name="Bezier", cpx=[0, 0.6741235852, 0.5261407495, 1], cpy=[0, 0, 1, 1])

# ---- group: interpolate - basics - data
# right click on the component and try different interpolation modes
merge_7 = Merge(Data1=number_slider_6, Data2=number_slider_7, Data3=number_slider_8)
range_3 = Range(Domain=Domain(0, 1), Steps=number_slider_9)
interp_3 = InterpolateData(Data=merge_7, Parameter=range_3, Interpolation=3)
graph_2 = QuickGraph(interp_3, SortOrder=0)

# ---- group: interpolate
interp_4 = InterpolateData(Data=flip_2, Parameter=graph, Interpolation=2)

# ----
height = Slider(5.64, range=0..10)
Z_3 = UnitZ(Factor=height)
move_2 = Move(Geometry=interp_4, Motion=Z_3)  # -> Geometry, Transform
merge_8 = Merge(Data1=flip_2, Data2=move_2.Geometry)
pline_3 = PolyLine(Vertices=merge_8, Closed=Toggle(True))

# ---- group: interpolate - point sequence
merge_9 = Merge(
    Data1=ColourSwatch(SwatchColor=RGB(255, 0, 0)),
    Data2=ColourSwatch(SwatchColor=RGB(33, 149, 191)),
    Data3=ColourSwatch(SwatchColor=RGB(255, 0, 208)))
range_4 = Range(Domain=Domain(0, 1), Steps=Slider(81, range=10..200))
interp_5 = InterpolateData(Data=merge_9, Parameter=range_4, Interpolation=2)

# try all the options (Block, Linear, Cubic, Catmull)
interp_6 = InterpolateData(Data=pt_12, Parameter=range_4, Interpolation=4)

preview_6 = CustomPreview(Geometry=interp_6, Material=interp_5)
