# Grasshopper definition a3_c01_lists basics.gh (Grasshopper 1.0.7)
# Copyright: Co-de-iT

# list length
series = Series(Start=0, Step=1, Count=10)
# Lists Basics
# 
# © a3 2018 _ Creative Commons Attribution-NonCommercial-ShareAlike3.0 UnportedLicense.
# basic operations
# list item & wrap mode
series_2 = Series(Start=0, Step=1, Count=10)
# zooming in on list item I can add as many outputs as I want.
# 
# The outputs are relative indexes compared to the value of i
number_slider = Slider(0, range=0..9)
# reverse list
# merge
series_3 = Series(Start=0, Step=1, Count=10)  # -> reverse(Series)
# sort list
# Sorts a list of entities A according to a corresponding key numeric value K.
# 
# A is optional, in which case only the numerical list K will be sorted.
# 
# Zooming in you can sort multiple lists with the same key by adding inputs/outputs
# 
# Lists K and A (and eventually B, C...) MUST have the same length
random = Random(Range=Domain(0, 100), Number=10, Seed=2, Integers=True)
charseq = CharSequence(Count=10, CharPool="ABCDEFGHIJKLMNOPQRSTUVWXYZ", Format="{0}")
panel = Panel(charseq)
series_4 = Series(Start=0, Step=1, Count="5")
series_5 = Series(Start="5", Step=1, Count="5")

# ---- group: list length
# List Length: counts the elements in a list
lng = ListLength(List=series)

# ----
# the option is present in almost every input/output of every component
rev = ReverseList(List=series)
panel_2 = Panel(random)

# ---- group: list item
item = ListItem(List=series_2, Index=number_slider, Wrap=True)  # -> Item1, Item, Item1_2, Item2

item_2 = ListItem(List=series_2, Index=number_slider, Wrap=True)

# ----
sort = SortList(Keys=random, ValuesA=charseq)  # -> Keys, ValuesA
# Merge: Joins 2 or more lists together, appending them in sequence: D2 starts right at the end of D1, and so on.
# 
# It's a dynamic component, so you can add as many input as needed
panel_3 = Panel(series_4)
panel_4 = Panel(series_5)
panel_5 = Panel(series_2)
panel_6 = Panel(lng)
panel_7 = Panel(rev)
merge = Merge(Data1=series_4, Data2=series_5)
panel_8 = Panel(item_2)
panel_9 = Panel(item.Item1)
panel_10 = Panel(item.Item)
panel_11 = Panel(item.Item1_2)
panel_12 = Panel(item.Item2)
panel_13 = Panel(sort.Keys)
panel_14 = Panel(sort.ValuesA)
panel_15 = Panel(merge)
# Wrap: When wrap is active, the list is circular, and the positive or negative sign on the index tells in which direction I am going while searching an item:
# 
# 0 - element at 0
# +1 - first element after 0
# +2 - second element after 0
# 
# -1 - first element BEFORE 0 (starts from the end of the list) - this is the last element
# 
# -2 - second element before 0 (the penultimate element)
# 
# ...and so on...
wrap = BooleanToggle(True)
# quiz
# play with me
series_6 = Series(Start=0, Step=1, Count=10)

# ---- group: list item
item_3 = ListItem(List=series_6, Index=Slider(-1, range=-10..10), Wrap=wrap)

# ----
panel_16 = Panel(series_6)
panel_17 = Panel(item_3)
# Modulus: Useful to make an index progess like a circular list, considering A the progressing index and B the length of the list.
# 
# Es: if B equals 2, the reminder of a division by 2 is either 0 or 1, if B equals 3 the reminder is either 0,1, or 2 and so on
wrap_2 = BooleanToggle(True)
division_pts = Slider(64, range=2..150)
item_index = Slider(13, range=0..150)
# examples
# the geometry is internalized in this component. To copy it in Rhino, you need to bake it.
crv = Curve(reparameterize(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))
pt = Point([Point(69, 51, 11.48105052), Point(68.96666667, 49.4, 11.40706153), Point(68.93333333, 47.8, 11.19529993), Point(68.9, 46.2, 10.86107379), Point(68.86666667, 44.6, 10.41969118), Point(68.83333333, 43, 9.886460168)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])
pdecon = Deconstruct(Point=pt)  # -> XComponent, YComponent, ZComponent
# Modulus: the remainder of the integer division A/B
# 
# Ex: A=14, B=12, the result is 2
divide = DivideCurve(Curve=crv, Count=division_pts, Kinks=False)  # -> Points, Tangents, Parameters

# ---- group: sort list
sort_2 = SortList(Keys=pdecon.ZComponent, ValuesA=pt)  # -> Keys, ValuesA

# ----
series_7 = Series(Start=0, Step=1, Count=10)

# ---- group: list length
lng_2 = ListLength(List=divide.Points)

# ----
bnd = Bounds(Numbers=sort_2.Keys)

# ---- group: modulus
mod = Modulus(A=item_index, B=lng_2)

# ----
mod_2 = Modulus(A=series_7, B=Slider(2, range=1..10))

# ---- group: list item
item_4 = ListItem(List=divide.Points, Index=item_index, Wrap=wrap_2)

# ----
dedomain = DeconstructDomain(Domain=bnd)  # -> Start, End
expression = Expression(x=item_index, y=mod, Expression="Format(\"slider: {0}  /  {1} : real index\", x, y)")
panel_18 = Panel(mod_2)
list_length = Panel(lng_2)
gradient = Gradient(
    LowerLimit=dedomain.Start,
    UpperLimit=dedomain.End,
    Parameter=sort_2.Keys,
    stops=[0.011: RGB(191, 8, 8), 0.999: RGB(255, 255, 255)])
Z = UnitZ(Factor=1)
line = LineSDL(Start=item_4, Direction=Z, Length=Slider(10, range=0..10))
# Expression allows the use of functions in GH
# 
# Format is a function to format text. {0} and {1} are, in this order, the parameters
# 
# Example:
# 
# Format("Hello {0}!", World) = "Hello World!"
swatch = ColourSwatch(SwatchColor=RGB(255, 255, 255))
preview = CustomPreview(Geometry=sort_2.ValuesA, Shader=gradient)
end = EndPoints(Curve=line)  # -> Start, End
# Fantastic Components
# and Where to Find Them
# per trovare chi è e cosa fa
# questo componente (o altri che non
# riconosci) tieni premuto CTRL+ALT
# e clicca con il tasto sx del mouse
# (tenendolo premuto) sul componente
preview_2 = CustomPreview(Geometry=line, Shader=swatch)
tag = TextTag3D(Location=end.End, Text=expression, Size=1, Colour=swatch, Justification=7)
