# Grasshopper definition a3_c02_lists-reference.gh (Grasshopper 1.0.7)
# Copyright: Co-de-iT

# ----
# data structure
# single data
# Series: create a series of C numbers starting fom S, and proceed by step N
number_slider = Slider(0, range=0..5)
# list
number_slider_2 = Slider(1, range=0..10)
series = Series(Start=number_slider, Step=number_slider_2, Count=Slider(10, range=2..30))

# ----
# Lists Basics
# 
# © a3 2018 _ Creative Commons Attribution-NonCommercial-ShareAlike3.0 UnportedLicense.
num = Number(42)
panel = Panel(series)
panel_2 = Panel(num)
# quiz
# play with me
viewer = ParamViewer(panel_2)
viewer_2 = ParamViewer(panel_2)
viewer_3 = ParamViewer(panel)
viewer_4 = ParamViewer(panel)
list_order = BooleanToggle(True)
# repeat/duplicate/stack data
panel_3 = Panel("""A
B
C""")
# cull index / cull pattern / cull nth
series_2 = Series(Start=0, Step=1, Count=10)
# list length
series_3 = Series(Start=0, Step=1, Count=10)
item_list = Panel("""new item 1
new item 2
new item 3""")
indexes = Panel("""0
1
2""")
# operations
# list item & wrap mode
series_4 = Series(Start=0, Step=1, Count=10)
# insert/replace items
series_5 = Series(Start=0, Step=1, Count=10)
# dispatch splits list L in two output channels according to a true/false pattern P - items associated with True are coming through A and False through B
charseq = CharSequence(Count=10, CharPool="ABCDEFGHIJKLMNOPQRSTUVWXYZ", Format="{0}")
charseq_2 = CharSequence(Count=10, CharPool="ABCDEFGHIJKLMNOPQRSTUVWXYZ", Format="{0}")
panel_4 = Panel("""3
1
2""")
# sift / combine
series_6 = Series(Start=0, Step=1, Count=10)
wrap = BooleanToggle(True)
panel_5 = Panel("""0
1
2""")
# zooming in on list item I can add as many outputs as I want.
# 
# The outputs are relative indexes compared to the value of i
number_slider_3 = Slider(0, range=0..9)
# reverse list
series_7 = Series(Start=0, Step=1, Count=10)  # -> reverse(Series)
# sort list
# Sorts a list of entities A according to a corresponding key numeric value K.
# 
# A is optional, in which case only the numerical list K will be sorted.
# 
# Zooming in you can sort multiple lists with the same key by adding inputs/outputs
# 
# Lists K and A (and eventually B, C...) MUST have the same length
random = Random(Range=Domain(0, 100), Number=10, Seed=2, Integers=True)
charseq_3 = CharSequence(Count=10, CharPool="ABCDEFGHIJKLMNOPQRSTUVWXYZ", Format="{0}")
# shift list
series_8 = Series(Start=0, Step=1, Count=10)
these_works_as_booleans = Panel("""0
0
1
1""")
# cull index and wrap: Cull index eliminates the item at the given index from a list. When wrap is true the list is treated as circular (think of hours in a clock, when you reach 12 you start back from 0)
panel_6 = Panel("true")
# dispatch / weave
pattern = Panel("""0
1""")
# sub list /split list/partition list
panel_7 = Panel(charseq_2)

# ---- group: Duplicate
dup = DuplicateData(Data=panel_3, Number="2", Order=list_order)

# ----
repeat = RepeatData(Data=panel_3, Length=Slider(20, range=0..20))

# ---- group: Stack data
stack = StackData(Data=panel_3, Stack=panel_4)

# ----
panel_8 = Panel(charseq_3)
cull_i = CullIndex(List=series_2, Indices="-1", Wrap=panel_6)
ins = InsertItems(List=series_5, Item=item_list, Indices=indexes, Wrap=True)
replace = ReplaceItems(List=series_5, Item=item_list, Indices=indexes, Wrap=False)
partition_pattern = Panel("""1
3
2""")

# ---- group: dispatch
dispatch = Dispatch(List=charseq, DispatchPattern=pattern)  # -> ListA, ListB

# ----
shift = ShiftList(List=series_8, Shift=Slider(0, range=-10..10), Wrap=wrap)
sift = SiftPattern(List=series_6, SiftPattern=panel_5)  # -> Output0, Output1, Output2
dom = ConstructDomain(DomainStart=Slider(2, range=0..9), DomainEnd=Slider(4, range=0..9))
bool = Boolean(these_works_as_booleans)

# ---- group: list length
# List Length: counts the elements in a list
lng = ListLength(List=series_3)

# ----
panel_9 = Panel(random)
# the option is present in almost every input/output of every component
rev = ReverseList(List=series_3)

# ---- group: list item
item = ListItem(List=series_4, Index=number_slider_3, Wrap=True)  # -> Item1, Item, Item1_2, Item2

item_2 = ListItem(List=series_4, Index=number_slider_3, Wrap=True)

# ----
sort = SortList(Keys=random, ValuesA=charseq_3)  # -> Keys, ValuesA
panel_10 = Panel(series_5)
insert = Panel(ins)
# There are a LOT of things here... but it's like the dictionary. Use it as a reference, but at least try once to see them all
panel_11 = Panel(series_4)
replace_2 = Panel(replace)
# Stack
# 
# repeats data pattern in item order using the stack pattern S (ideally one number for each item in the list)
panel_12 = Panel(stack)
# Duplicate
# 
# repeats data pattern N times, in list or item order
panel_13 = Panel(dup)
# Duplicate
# 
# repeats data pattern in list order until it reaches the length L, truncating the last list if necessary
panel_14 = Panel(repeat)
panel_15 = Panel(bool)
panel_16 = Panel(dom)
partition = PartitionList(List=charseq_2, Size=partition_pattern)
panel_17 = Panel(series_2)
panel_18 = Panel(cull_i)
panel_19 = Panel(series_8)

# ---- group: sub list
subset = SubList(List=charseq_2, Domain=dom, Wrap=True)  # -> List, Index

# ---- group: split list
split = SplitList(List=charseq_2, Index=Slider(5, range=0..9))  # -> ListA, ListB

# ----
concat = Concatenate(FragmentA=dispatch.ListA, FragmentB="U")
panel_20 = Panel(lng)
panel_21 = Panel(dispatch.ListB)

# ---- group: cull pattern
cull = CullPattern(List=series_2, CullPattern=these_works_as_booleans)

# ----
panel_22 = Panel(dispatch.ListA)

# ---- group: cull nth
culln = CullNth(List=series_2, CullFrequency="2")

# ----
panel_23 = Panel(rev)
panel_24 = Panel(item_2)
panel_25 = Panel(item.Item1)
panel_26 = Panel(item.Item)
panel_27 = Panel(item.Item1_2)
panel_28 = Panel(item.Item2)
multiplication = Multiplication(A=sift.Output1, B="5")
multiplication_2 = Multiplication(A=sift.Output2, B="10")
panel_29 = Panel(sort.Keys)
shifted = Panel(shift)
panel_30 = Panel(sort.ValuesA)
panel_31 = Panel(subset.List)
panel_32 = Panel(split.ListA)
panel_33 = Panel(subset.Index)
panel_34 = Panel(split.ListB)
panel_35 = Panel(partition)

# ---- group: weave
# Weave is quite literal: accoding to the weaving pattern P of channels it pulls an item from 0 or 1 (or more if there are more) and appends it to the output list
weave = Weave(Pattern=pattern, Stream0=dispatch.ListB, Stream1=concat, NullGaps=False)

# ----
panel_36 = Panel(cull)
panel_37 = Panel(culln)
combine = CombineData(Input0=sift.Output0, Input1=multiplication, Input2=multiplication_2)  # -> Result, Index
# Wrap: When wrap is active, the list is circular, and the positive or negative sign on the index tells in which direction I am going while searching an item:
# 
# 0 - element at 0
# +1 - first element after 0
# +2 - second element after 0
# 
# -1 - first element BEFORE 0 (starts from the end of the list) - this is the last element
# 
# -2 - second element before 0 (the penultimate element)
# 
# ...and so on...
wrap_2 = BooleanToggle(True)
series_9 = Series(Start=0, Step=1, Count=10)

# ---- group: list item
item_3 = ListItem(List=series_9, Index=Slider(-1, range=-10..10), Wrap=wrap_2)

# ----
panel_38 = Panel(combine.Result)
panel_39 = Panel(weave)
panel_40 = Panel(series_9)
panel_41 = Panel(item_3)
