# Grasshopper definition a3_c03_tree basics.gh (Grasshopper 1.0.7)
# Copyright: Co-de-iT

# ----
# data tree
number_slider = Slider(3, range=0..5)
count_n_branches = Slider(7, range=2..30)
count_n_of_items_in_each_list = Slider(6, range=2..30)

# ----
# Quiz: Adjust the parameters so that the tree contains a continuous sequence of numbers like the one below:
# move this panel away to uncover the results
# Start = 0
# Step = 4
# n. branches = 5
# n. items = 4
panel = Panel("""            {0;0;0}
0. 0
1. 1
2. 2
3. 3
            {0;0;1}
0. 4
1. 5
2. 6
3. 7
            {0;0;2}
0. 8
1. 9
2. 10
3. 11
            {0;0;3}
0. 12
1. 13
2. 14
3. 15
            {0;0;4}
0. 16
1. 17
2. 18
3. 19""")

# ----
# single data
# Series: create a series of C numbers starting fom S, and proceed by step N
number_slider_2 = Slider(0, range=0..5)
# list
number_slider_3 = Slider(1, range=0..10)
series = Series(Start=number_slider_2, Step=number_slider_3, Count=Slider(10, range=2..30))

# ----
# Series of Series: by feeding a list in S, the component will create as many series as the numbers in the list, using each as the starting point of a new series.
# 
# To keep the data neatly sorted, each series is stored in a separate branch.
series_2 = Series(Start=number_slider, Step=Slider(2, range=0..10), Count=count_n_branches)
# Data tree Basics
# 
# © a3 2018 _ Creative Commons Attribution-NonCommercial-ShareAlike3.0 UnportedLicense.
num = Number(42)
series_3 = Series(Start=series_2, Step=1, Count=count_n_of_items_in_each_list)
panel_2 = Panel(series_3)
panel_3 = Panel(series)
# data structure
panel_4 = Panel(num)
# quiz
# play with me
viewer = ParamViewer(panel_4)
viewer_2 = ParamViewer(panel_4)
viewer_3 = ParamViewer(panel_3)
viewer_4 = ParamViewer(panel_3)
viewer_5 = ParamViewer(panel_2)
viewer_6 = ParamViewer(panel_2)
# Shift Paths: negative value erase paths from the right:
# 
# -1
# {A;B;C;D} -> {A;B;C}
# 
# positive values erase paths from the left:
# 
# +1
# {A;B;C;D} -> {B;C;D}
# default value is -1
# 
# which is like flattening only the last order of branches
number_slider_4 = Slider(-1, range=-4..4)
series_4 = Series(Start=0, Step=1, Count=10)
series_5 = Series(Start=0, Step=1, Count=10)  # -> graft(Series)

# ---- group: inherited data from somewhere
# simplify
# Simplify: removes all non-changing indices from the data tree index (ex. unnecessary zeros)
# 
# {0;A}(i) -> {A}(i)
num_2 = Number(Tree({0;0;0;0}: [0], {0;0;0;1}: [1], {0;0;0;2}: [2], {0;0;0;3}: [3], {0;0;0;4}: [4], {0;0;1;0}: [1]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))

# flatten
num_3 = Number(Tree({0;0;0;0}: [0], {0;0;0;1}: [1], {0;0;0;2}: [2], {0;0;0;3}: [3], {0;0;0;4}: [4], {0;0;1;0}: [1]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))

# shift paths
num_4 = Number(Tree({0;0;0;0}: [0], {0;0;0;1}: [1], {0;0;0;2}: [2], {0;0;0;3}: [3], {0;0;0;4}: [4], {0;0;1;0}: [1]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))

# ---- group: inherited generic data
# flip matrix
data = Data(Tree({0;0}: ["0-0", "0-1", "0-2", "0-3", "0-4"], {0;1}: ["1-0", "1-1", "1-2", "1-3", "1-4"], {0;2}: ["2-0", "2-1", "2-2", "2-3", "2-4"]))

# ----
num_5 = Number(flatten(num_3))
pshift = ShiftPaths(Data=num_4, Offset=number_slider_4)
flip = FlipMatrix(Data=data)
flatten = FlattenTree(Tree=num_3, Path="{0}")
# graft
graft = GraftTree(Tree=series_4, IncludeEmptyLists=True, IncludeNullItems=True)
data_2 = Data(simplify(num_2))
panel_5 = Panel(series_5)
panel_6 = Panel(num_3)
# operations
panel_7 = Panel(graft)
panel_8 = Panel(num_5)
panel_9 = Panel(flatten)
panel_10 = Panel(num_4)
panel_11 = Panel(data)
panel_12 = Panel(pshift)
panel_13 = Panel(flip)
viewer_7 = ParamViewer(num_2)
viewer_8 = ParamViewer(data_2)

# ----
# Quiz: if I have a tree structure like this one:
# 
# {0;A;0;B;C}(i)
# 
# 1. How many lists do I have after a Flatten?
# 
# 2. What's the tree structure after a Graft?
# 
# 3. What's the tree structure after a Simplify?
# 
# 4. What's the tree structure after a Shift Paths of -1? And a Shift Paths of 1?
# 
# 5. Can I use Flip Matrix on it?
# move this panel away to uncover the results
quiz_results = Panel("""1. one

2. {0;A;0;B;C;i}

3. {A;B;C}(i)

4. {0;A;0;B}(i) and {A;0;B;C}(i)

5. no""")

viewer_9 = ParamViewer(panel_6)
viewer_10 = ParamViewer(panel_8)
viewer_11 = ParamViewer(panel_10)
viewer_12 = ParamViewer(panel_12)
viewer_13 = ParamViewer(panel_5)
viewer_14 = ParamViewer(panel_5)
viewer_15 = ParamViewer(panel_11)
# when a data tree can be read as a Matrix, meaning the structure is like {A}(i) (A - index of branch, i - index of item), then it transposes the matrix, ordering the data like this:
# 
# {A}(i) -> {i}(A)
# 
# In this case the structure is {A;B}(i), but A is always 0 (a constant index), so it doesn't affect the structure (you can even remove it with simplify). The operation Flip Matrix does in this case then is:
# 
# {A;B}(i) -> {A;i}(B)
viewer_16 = ParamViewer(panel_11)
viewer_17 = ParamViewer(panel_13)
viewer_18 = ParamViewer(panel_13)

min_radius = Slider(0.134, range=0..1)
max_radius = Slider(0.693, range=0..1)

# ----
# examples
series_6 = Series(Start=0, Step=1, Count=10)
pt = Point(Point(15, 0, 0))
pt_2 = ConstructPoint(XCoordinate=series_6, YCoordinate=series_6, ZCoordinate=0)
recgrid = Rectangular(
    Plane=pt,
    SizeX=Slider(1, range=1..2),
    SizeY=Slider(2, range=1..2),
    ExtentX=Slider(5, range=2..50),
    ExtentY=Slider(9, range=2..50))  # -> Cells, Points
dom = ConstructDomain(DomainStart=min_radius, DomainEnd=max_radius)
lng = ListLength(List=pt_2)
random = Random(Range=dom, Number=lng, Seed=2)

# ----
# plug them one at the time in the G input and notice the differences in how the data is associated (center points with radiuses, which goes with which and why)
cir = Circle(Plane=graft(pt_2), Radius=random)
cir_2 = Circle(Plane=pt_2, Radius=graft(random))
cir_3 = Circle(Plane=graft(pt_2), Radius=graft(random))
cir_4 = Circle(Plane=pt_2, Radius=random)
preview = CustomPreview(Geometry=cir_4, Material=ColourSwatch(SwatchColor=RGB(255, 255, 255)))

# ----
# plug them one at the time in the Point component input and notice the differences in how the data is associated (how polylines are different and why).
# 
# If necessary use Point List to check the points order
pt_3 = Point(recgrid.Points)
flip_2 = FlipMatrix(Data=pt_3)
flatten_2 = FlattenTree(Tree=pt_3, Path="{0}")
pt_4 = Point(pt_3)
pline = PolyLine(Vertices=pt_4, Closed=False)
points = PointList(Points=pt_4, Size="0.5")
dots = DotDisplay(Point=pt_4, Colour=RGB(0, 0, 0), Size="0.1")
preview_2 = CustomPreview(Geometry=pline, Material=ColourSwatch(SwatchColor=RGB(255, 255, 255)))

viewer_19 = ParamViewer(pt_3)
# you followed the cable.... you little rebel. I like you.
panel_14 = Panel(".")

# ---- group: and this is how the matrix up there is created...
panel_15 = Panel("""0
1
2
3""")
dup = DuplicateData(Data=panel_15, Number="3", Order=True)
lng_2 = ListLength(List=panel_15)
matrix = ConstructMatrix(Rows="3", Columns=lng_2, Values=dup)

# ----
# A = 0
# {A;B}(i)
# i
# before flip matrix
# basically we change the direction in which the data is structured
# 0
# B
# 1
# DON'T
# follow
# this
# cable!
# 2
# {A;i}(B)
# after flip matrix
matrix_2 = DisplayMatrix(matrix, Digits=0)
