# Grasshopper definition day01_01.gh (Grasshopper 1.0.7)
# Copyright: Co-de-iT

panel = Panel("""0<500.000<1000
0<500<1000
0<1000
0<<1000""")
number_slider = Slider(500, range=0..1000)
number_slider_2 = Slider(500, range=0..1000)
number_slider_3 = Slider(500, range=0..1000)
number_slider_4 = Slider(0, range=0..1000)
pt = Point([<point referenced from the Rhino model> x4])
pt_2 = Point([<point referenced from the Rhino model> x6])
vec = Point(<point referenced from the Rhino model>)
pt_3 = Point(<point referenced from the Rhino model>)
ln = Line(StartPoint=pt_2, EndPoint=pt)

panel_2 = Panel("CTRL+Q toggle preview")
crv = Curve(reparameterize(<curve referenced from the Rhino model>))
crv_2 = Curve(reparameterize(<curve referenced from the Rhino model>))
panel_3 = Panel(crv_2)
eval = EvaluateCurve(Curve=crv_2, Parameter=Slider(0.044, range=0..1))  # -> Point, Tangent, Angle
eval_2 = EvaluateCurve(Curve=crv, Parameter=Slider(0.769, range=0..1))  # -> Point, Tangent, Angle
domain = Domain(crv_2)
amp = Amplitude(Vector=eval_2.Tangent, Amplitude=Slider(306.037, range=0..1000))
amp_2 = Amplitude(Vector=eval.Tangent, Amplitude=Slider(329.5, range=0..1000))
panel_4 = Panel(domain)
ln_2 = Line(StartPoint=eval.Point, EndPoint=eval_2.Point)
vdisex = VectorDisplayEx(Point=eval.Point, Vector=amp_2, Colour=RGB(0, 0, 0), Width=2)
panel_5 = Panel(eval.Point)
panel_6 = Panel(eval.Tangent)
rev = Reverse(Vector=amp)
panel_7 = Panel(eval.Angle)
vdis = VectorDisplay(Anchor=eval.Point, Vector=eval.Tangent)
vdisex_2 = VectorDisplayEx(Point=eval_2.Point, Vector=rev, Colour=RGB(0, 0, 0), Width=2)
bzspan = BezierSpan(StartPoint=eval.Point, StartTangent=amp_2, EndPoint=eval_2.Point, EndTangent=rev)  # -> Curve, Length, Domain

# ----
# File template
# 
# © a3 2019 _ Creative Commons Attribution-NonCommercial-ShareAlike3.0 UnportedLicense.
panel_8 = Panel("12.876")

dom = ConstructDomain(DomainStart=Slider(0.53, range=0..1), DomainEnd=Slider(0.84, range=0..1))
range = Range(Domain=dom, Steps=Slider(10, range=1..20))
eval_3 = EvaluateCurve(Curve=crv, Parameter=range)  # -> Point, Tangent, Angle
bzspan_2 = BezierSpan(StartPoint=eval.Point, StartTangent=amp_2, EndPoint=eval_3.Point, EndTangent=rev)  # -> Curve, Length, Domain

panel_9 = Panel(pt_2)
# line creates a line from 2 points
ln_3 = Line(StartPoint=vec, EndPoint=pt_3)
num = Number(panel_8)
panel_10 = Panel(pt_3)
panel_11 = Panel(pt)
panel_12 = Panel(ln)
geo = Geometry([vec, ln_3, pt_3])
item = ListItem(List=geo, Index="1", Wrap=True)
data = Data()
panel_13 = Panel(geo)
X = UnitX(Factor=Slider(500, range=0..1000))
number_slider_5 = Slider(14, range=1..500)
merge = Merge(Data1=crv_2, Data2=crv)
move = Move(Geometry=crv, Motion=X)  # -> Geometry, Transform
move_2 = Move(Geometry=crv_2, Motion=X)  # -> Geometry, Transform
panel_14 = Panel(merge)
move_3 = Move(Geometry=merge, Motion=X)  # -> Geometry, Transform
divide = DivideCurve(Curve=move.Geometry, Count=number_slider_5, Kinks=False)  # -> Points, Tangents, Parameters
divide_2 = DivideCurve(Curve=move_2.Geometry, Count=number_slider_5, Kinks=False)  # -> Points, Tangents, Parameters
divide_3 = DivideCurve(Curve=move_3.Geometry, Count=Slider(70, range=1..500), Kinks=False)  # -> Points, Tangents, Parameters
toggle = BooleanToggle(False)
lng = ListLength(List=divide_2.Points)
panel_15 = Panel(toggle)
panel_16 = Panel(divide_2.Points)
panel_17 = Panel(divide_3.Points)
item_2 = ListItem(List=divide_2.Points, Index=Slider(9, range=0..40), Wrap=toggle)
viewer = ParamViewer(divide_3.Points)
panel_18 = Panel(lng)
viewer_2 = ParamViewer(divide_3.Points)
ln_4 = Line(StartPoint=item_2, EndPoint=divide.Points)
pt_4 = Point(<point referenced from the Rhino model>)
Z = UnitZ(Factor=Slider(410.268, range=0..1000))
cir = Circle(Plane=pt_4, Radius=Slider(200, range=0..200))
move_4 = Move(Geometry=cir, Motion=Z)  # -> Geometry, Transform
number_slider_6 = Slider(50, range=2..50)
end = EndPoints(Curve=cir)  # -> Start, End
series = Series(Start=0, Step=1, Count=10)
panel_19 = Panel(series)
divide_4 = DivideCurve(Curve=move_4.Geometry, Count=number_slider_6, Kinks=False)  # -> Points, Tangents, Parameters
divide_5 = DivideCurve(Curve=cir, Count=number_slider_6, Kinks=False)  # -> Points, Tangents, Parameters
shift = ShiftList(List=series, Shift=Slider(-1, range=-10..10), Wrap=Toggle(False))
shift_2 = ShiftList(List=divide_4.Points, Shift=Slider(18, range=-30..30), Wrap=True)
panel_20 = Panel(shift)
ln_5 = Line(StartPoint=divide_5.Points, EndPoint=shift_2)
points = PointList(Points=shift_2, Size="15")
points_2 = PointList(Points=divide_5.Points, Size="15")
toggle_2 = BooleanToggle(True)
addition = Addition(A="-1", B=toggle_2)
number_slider_7 = Slider(0, range=0..10)
shift_3 = ShiftList(List=ln_5, Shift=addition, Wrap=toggle_2)
shift_4 = ShiftList(List=ln_5, Shift="1", Wrap=toggle_2)
item_3 = ListItem(List=shift_4, Index=number_slider_7, Wrap=True)
item_4 = ListItem(List=shift_3, Index=number_slider_7, Wrap=True)
merge_2 = Merge(Data1=graft(shift_3), Data2=graft(shift_4))
loft = Loft(Curves=merge_2, Options={Adjust=False, Closed=False, LoftEnds=0, LoftSimp=0, LoftType=0, Rebuild=10, Refit=0.01})
merge_3 = Merge(Data1=item_4, Data2=item_3)
preview = CustomPreview(Geometry=merge_3, Material=ColourSwatch(SwatchColor=RGB(0, 0, 0)))
loft_2 = Loft(Curves=merge_3, Options={Adjust=False, Closed=False, LoftEnds=0, LoftSimp=0, LoftType=0, Rebuild=10, Refit=0.01})
preview_2 = CustomPreview(Geometry=loft_2, Material=ColourSwatch(SwatchColor=RGB(255, 255, 255)))
